vi "Main.gviweb"   [LabVIEW NXG 2.0.0]
panel controls:
  "Data Grid": T1[]
panel indicators:
  "Observed Data and Fitted Curve": cluster{"Element 1": f64, "Element 2": f64}[][]
  "Test Step Status": bool
types:
  T1 = cluster{"Step": string, "Progress": f64, "Status": bool}
  T2 = cluster{"X": f64[], "Y": f64[], "Best Gaussian Fit": f64[], "Upper Bound": f64[], "Lower Bound": f64[]}
uses:
  NI::HTTP::GET.gvi
diagram:
  while {
    Wait(time to wait=500)
    call "GET.gvi"(url="http://127.0.0.1:8001/hal/parametric-curve") -> (body=w1)
    Unflatten From JSON(JSON string=w1, type and defaults=T2 {all zero or empty}) -> (value=w2)
    Property Node(instance in=w2) -> ("X"=w3, "Y"=w4, "Best Gaussian Fit"=w5, "Upper Bound"=w6, "Lower Bound"=w7)
    Build Index And Bundle Cluster Array(w3, w4) -> (out=w8)
    Build Index And Bundle Cluster Array(w3, w5) -> (out=w9)
    Build Index And Bundle Cluster Array(w3, w6) -> (out=w10)
    Build Index And Bundle Cluster Array(w3, w7) -> (out=w11)
    Build Array(w8, w9, w10, w11) -> w12
    $"Observed Data and Fitted Curve" <- w12
    stop if FALSE
  }
